# Grasshopper definition GH#_001_Basics.gh (Grasshopper 1.0.7)
# plug-ins: Bifocals

panel = Panel("""0
10
20
30
40""")
number_slider = Slider(10, range=0..10)
toggle = BooleanToggle(False)
c_script = CSharpScript(L=panel, i=number_slider, W=toggle)  # -> out, iOut; inputs L: list, i: Int32, W: Boolean
# ---------- c_script: C# ----------
    
    int pos = i;
    if (pos >= L.Count) {
      if (W) {
        pos = i % L.Count;
      }
      else {
        Component.AddRuntimeMessage(GH_RuntimeMessageLevel.Warning, "Supply index is too high");
        return;
      }
    }
    
    object datum = L[pos];
    
    iOut = datum;
# ---------- end c_script ----------
item = ListItem(List=panel, Index=number_slider, Wrap=toggle)
panel_2 = Panel(c_script.iOut)
panel_3 = Panel(item)

number_slider_2 = Slider(5.79, range=0..10)
number_slider_3 = Slider(3.97, range=0..10)
c_script_2 = CSharpScript(A=number_slider_2, B=number_slider_3)  # -> out, R; inputs A: Double, B: Double
# ---------- c_script_2: C# ----------
    // Here we write our awesome code.
    double sum = A + B;

    // Outputs
    R = sum;
# ---------- end c_script_2 ----------
addition = Addition(A=number_slider_2, B=number_slider_3)
panel_4 = Panel(c_script_2.R)
panel_5 = Panel(addition)

number_slider_4 = Slider(4.51, range=0..10)
number_slider_5 = Slider(0.224, range=-10..10)
number_slider_6 = Slider(5, range=0..10)
c_script_3 = CSharpScript(S=number_slider_4, N=number_slider_5, C=number_slider_6)  # -> out, SOut; inputs S: Double, N: Double, C: Int32
# ---------- c_script_3: C# ----------
    // Doing it with a list
    /*
    List<double> nums = new List<double>();

    for (int i = 0; i < C; i++) {
      double val = S + N * i;
      nums.Add(val);
    }*/
    
    double[] nums = new double[C];
    for (int i = 0; i < C; i++) {
      double val = S + N * i;
      nums[i] = val;
    }
    
    SOut = nums;
# ---------- end c_script_3 ----------
series = Series(Start=number_slider_4, Step=number_slider_5, Count=number_slider_6)
panel_6 = Panel(series)
panel_7 = Panel(c_script_3.SOut)

number_slider_7 = Slider(5, range=0..10)
dom = ConstructDomain(DomainStart=Slider(7.15, range=0..10), DomainEnd=Slider(3, range=0..10))
range = Range(Domain=dom, Steps=number_slider_7)
c_script_4 = CSharpScript(D=dom, N=number_slider_7)  # -> out, R; inputs N: Int32
# ---------- c_script_4: C# ----------
    double step = D.Length / N;
    Print("step size " + step);

    List<double> nums = new List<double>();
    for (int i = 0; i <= N; i++) {
      double val = D.T0 + step * i;
      nums.Add(val);
    }

    R = nums;
# ---------- end c_script_4 ----------
panel_8 = Panel(range)
panel_9 = Panel(c_script_4.R)

number_slider_8 = Slider(4.93, range=0..10)
number_slider_9 = Slider(3.52, range=0..10)
number_slider_10 = Slider(4.07, range=0..10)
pt = ConstructPoint(XCoordinate=number_slider_8, YCoordinate=number_slider_10, ZCoordinate=number_slider_9)
c_script_5 = CSharpScript(X=number_slider_8, Y=number_slider_10, Z=number_slider_9)  # -> out, Pt; inputs X: Double, Y: Double, Z: Double
# ---------- c_script_5: C# ----------
    Point3d p = new Point3d(X, Y, Z);
    
    Pt = p;
# ---------- end c_script_5 ----------
panel_10 = Panel(pt)
panel_11 = Panel(c_script_5.Pt)
pdecon = Deconstruct(Point=pt)  # -> XComponent, YComponent, ZComponent
c_script_6 = CSharpScript(P=c_script_5.Pt)  # -> out, X, Y, Z; inputs P: Point3d
# ---------- c_script_6: C# ----------
    X = P.X;
    Y = P.Y;
    Z = P.Z;
# ---------- end c_script_6 ----------
panel_12 = Panel(pdecon.XComponent)
panel_13 = Panel(pdecon.YComponent)
panel_14 = Panel(pdecon.ZComponent)
panel_15 = Panel(c_script_6.X)
panel_16 = Panel(c_script_6.Y)
panel_17 = Panel(c_script_6.Z)

vec = VectorXYZ(XComponent=Slider(4.93, range=0..10), YComponent=Slider(3.48, range=0..10), ZComponent=Slider(3.52, range=0..10))  # -> Vector, Length
c_script_7 = CSharpScript(V=vec.Vector)  # -> out, L; inputs V: Vector3d
# ---------- c_script_7: C# ----------
    //double len = Math.Sqrt(V.X * V.X + V.Y * V.Y + V.Z * V.Z);
    
    double len = V.Length;
    
    L = len;
# ---------- end c_script_7 ----------
vlen = VectorLength(Vector=vec.Vector)
panel_18 = Panel(vlen)
panel_19 = Panel(c_script_7.L)

toggle_2 = BooleanToggle(False)
vec_2 = VectorXYZ(XComponent=Slider(2.83, range=0..10), YComponent=Slider(5.94, range=0..10), ZComponent=Slider(6.85, range=0..10))  # -> Vector, Length
vec_3 = VectorXYZ(XComponent=Slider(4.93, range=0..10), YComponent=Slider(3.84, range=0..10), ZComponent=Slider(3.52, range=0..10))  # -> Vector, Length

pt_2 = ConstructPoint(XCoordinate=Slider(2.81, range=0..10), YCoordinate=Slider(5.2, range=0..10), ZCoordinate=Slider(2.28, range=0..10))
pt_3 = ConstructPoint(XCoordinate=Slider(2.77, range=0..10), YCoordinate=Slider(3.98, range=0..10), ZCoordinate=Slider(6.47, range=0..10))
ln = Line(StartPoint=pt_2, EndPoint=pt_3)
c_script_8 = CSharpScript(A=pt_2, B=pt_3)  # -> out, L; inputs A: Point3d, B: Point3d
# ---------- c_script_8: C# ----------
    Line line = new Line(A, B);
    
    L = line;
# ---------- end c_script_8 ----------
panel_20 = Panel(ln)
panel_21 = Panel(c_script_8.L)

pt_4 = ConstructPoint(XCoordinate=Slider(4.93, range=0..10), YCoordinate=Slider(4.07, range=0..10), ZCoordinate=Slider(3.52, range=0..10))

dprod = DotProduct(VectorA=vec_3.Vector, VectorB=vec_2.Vector, Unitize=toggle_2)
c_script_9 = CSharpScript(A=vec_3.Vector, B=vec_2.Vector, U=toggle_2)  # -> out, D; inputs A: Vector3d, B: Vector3d, U: Boolean
# ---------- c_script_9: C# ----------
    if (U) {
      A.Unitize();
      B.Unitize();
    }

    // double dot = A.X * B.X + A.Y * B.Y + A.Z * B.Z;
    // double dot = A * B;
    double dot = Vector3d.Multiply(A, B);

    D = dot;
# ---------- end c_script_9 ----------
panel_22 = Panel(dprod)
panel_23 = Panel(c_script_9.D)

c_script_10 = CSharpScript(A=vec_3.Vector, B=vec_2.Vector, U=toggle_2)  # -> out, V, L; inputs A: Vector3d, B: Vector3d, U: Boolean
# ---------- c_script_10: C# ----------
    
    if (U) {
      A.Unitize();
      B.Unitize();
    }
    
    Vector3d cross = Vector3d.CrossProduct(A, B);

    V = cross;
    L = cross.Length;
# ---------- end c_script_10 ----------
xprod = CrossProduct(VectorA=vec_3.Vector, VectorB=vec_2.Vector, Unitize=toggle_2)  # -> Vector, Length
panel_24 = Panel([c_script_10.V, c_script_10.L])
panel_25 = Panel([xprod.Vector, xprod.Length])
